# Grasshopper definition robo scope UDP2can.gh (Grasshopper 1.0.7)
# plug-ins: gHowl

# ---- group: Depth
c_script = CSharpScript(Path="/Users/haoch/Desktop/", Save=Button())  # -> ViewportName; inputs Path: String, Save: Boolean
# ---------- c_script: C# usings ----------
using System.Drawing;

using Rhino.DocObjects;
using Rhino.Collections;
# ---------- c_script: C# ----------
    // Get rhino active view
    Rhino.Display.RhinoView view = doc.Views.ActiveView;
    Rhino.Display.RhinoPageView pageview = view as Rhino.Display.RhinoPageView;

    // Return its name
    string viewport_name = view.MainViewport.Name;
    ViewportName = viewport_name;
    
    string DepthPath = Path + "/depth.jpg";
    string ImagePath = Path + "/image.jpg";
  
    // if the save toggle is true
    if (Save)
    {
      // Switch to ZBuffer
      Rhino.RhinoApp.RunScript("ShowZBuffer", false);
      // Capture to file
      Bitmap depthImage = view.CaptureToBitmap();
      depthImage.Save(DepthPath);
      // Switch out of ZBuffer
      Rhino.RhinoApp.RunScript("ShowZBuffer", false);
      
      // save the basic viewport image
      Bitmap baseImage = view.CaptureToBitmap();
      baseImage.Save(ImagePath);
    }
# ---------- end c_script ----------
panel = Panel(c_script)

# ----
size = Slider(8, range=0..100)
x_count = Slider(4, range=0..20)
y_count = Slider(4, range=0..20)

# ---- group: Cube Height Control
_0 = Slider(10, range=0..20)
_1 = Slider(10, range=0..20)
_2 = Slider(10, range=0..20)
_3 = Slider(10, range=0..20)
_4 = Slider(10, range=0..20)
_5 = Slider(10, range=0..20)
_6 = Slider(10, range=0..20)
_7 = Slider(10, range=0..20)
_8 = Slider(10, range=0..20)
_9 = Slider(10, range=0..20)
_10 = Slider(10, range=0..20)
_11 = Slider(10, range=0..20)
_12 = Slider(10, range=0..20)
_13 = Slider(10, range=0..20)
_14 = Slider(10, range=0..20)
_15 = Slider(10, range=0..20)

# ----
sqgrid = Square(Plane=PlaneXY(0, 0, 0), Size=size, ExtentX=x_count, ExtentY=y_count)  # -> flatten(Cells), Points
merge = Merge(
    Data1=_0,
    Data2=_1,
    Data3=_2,
    Data4=_3,
    Data5=_4,
    Data6=_5,
    Data7=_6,
    Data8=_7,
    Data9=_8,
    Data10=_9,
    Data11=_10,
    Data12=_11,
    Data13=_12,
    Data14=_13,
    Data15=_14,
    Data16=_15)
cluster = Cluster(B=sqgrid.Cells, F=merge, _2=merge, L=merge, relay=y_count)  # -> B_2, R
edges = BrepEdges(Brep=cluster.B_2)  # -> Naked, Interior, NonManifold
cluster_2 = Cluster_2(G=sqgrid.Cells, A=size, A_2=merge)  # -> G_2, R
points = PointList(Points=flatten(cluster_2.G_2), Size=cluster_2.R)
preview = CustomPreview(Geometry=cluster.B_2, Material=ColourSwatch(SwatchColor=RGB(255, 255, 255)))
preview_2 = CustomPreview(Geometry=[edges.Naked, edges.Interior, edges.NonManifold], Material=ColourSwatch(SwatchColor=RGB(0, 0, 0)))
_2udp = Panel(cluster.R)

# ---- group: UDP Sender
ip = Panel("10.100.2.97")
port = Panel("5005")
udp_owl = UDPSender(Address=ip, Port=port, Pattern=0, Data=_2udp)

# ==== cluster Cluster
B = ClusterInput()
F = ClusterInput()
_2 = ClusterInput()
L = ClusterInput()
relay = ClusterInput()
Z = UnitZ(Factor=F)
lng = ListLength(List=L)
extr = Extrude(Base=B, Direction=Z)
cap = CapHoles(Brep=extr)
B_2 = ClusterOutput(cap)
series = Series(Start=0, Step=1, Count=lng)
integer_division = IntegerDivision(A=series, B=relay)
mod = Modulus(A=series, B=relay)
repeat = RepeatData(Data="(\"position\": (\"x\": {0}, \"y\": {1}), \"height\": {2})", Length=lng)
format = Format(Format=repeat, Culture=127, Data0=integer_division, Data1=mod, Data2=_2)
join = TextJoin(Text=format, Join=",")
rep = ReplaceText(Text=join, Find="(", Replace="{", RecursiveReplace=False)
rep_2 = ReplaceText(Text=rep, Find=")", Replace="}", RecursiveReplace=False)
merge = Merge(Data1="{\"data\":[", Data2=flatten(rep_2), Data3="]}")
join_2 = TextJoin(Text=merge)
R = ClusterOutput(join_2)

# ==== cluster Cluster_2
G = ClusterInput()
A = ClusterInput()
A_2 = ClusterInput()
division = Division(A=A, B="10")
R = ClusterOutput(division)
area = Area(Geometry=G)  # -> Area, Centroid
multiplication = Multiplication(A=A_2, B="1.1")
Z = UnitZ(Factor=multiplication)
move = Move(Geometry=area.Centroid, Motion=Z)  # -> Geometry, Transform
G_2 = ClusterOutput(move.Geometry)
